# Grasshopper definition IncidentRadiation.gh (Grasshopper 1.0.8)

panel = Panel("12")
# Analysis Period for
# Summer Solstice
panel_2 = Panel("1")
# Import Location from EPW File
downloadepw = LBDownloadWeather()  # -> epw_file, stat_file, ddy_file; plug-in component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
analysisperiod = LBAnalysisPeriod(start_month=panel_2, start_day="21", start_hour=0, end_day="21", timestep="1")  # -> period, hoys, dates; plug-in component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
file_path = FilePath("C:\Users\Seilsl\Documents\epw\USA_GA_Atlanta.722190_TMY2.epw")
importloc = LBImportLocation(epw_file=file_path)  # -> location; plug-in component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
importepw = LBImportEPW(epw_file=file_path)  # -> location, dry_bulb_temperature, dew_point_temperature, relative_humidity, wind_speed, wind_direction, direct_normal_rad, diffuse_horizontal_rad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; plug-in component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

# ----
# Create Sunpath
panel_3 = Panel("20")
sunpath = LBSunPath(north=panel_3, hoys=analysisperiod.hoys, scale=1)  # -> report, vectors, altitudes, azimuths, hoys, sun_pts, analemma, daily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; plug-in component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

colrange = LBColorRange(index=Slider(8, range=0..26))  # -> colors; plug-in component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
panel_4 = Geometry(<surface referenced from the Rhino model>)
legendpar = LBLegendParameters(colors=colrange)  # -> leg_par; plug-in component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
geo = Geometry([<surface referenced from the Rhino model> x14])
skymatrix = LBCumulativeSkyMatrix(
    location=importepw.location,
    direct_rad=importepw.direct_normal_rad,
    diffuse_rad=importepw.diffuse_horizontal_rad,
    hoys=analysisperiod.hoys)  # -> out, sky_mtx; plug-in component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

# ---- group: Run Me!
toggle = BooleanToggle(False)

# ----
# Run Direct Sun Study
directsunhours = LBDirectSunHours(
    vectors=flatten(sunpath.vectors),
    timestep="1",
    geometry=flatten(panel_4),
    context=flatten(geo),
    grid_size="2",
    offset_dist="0.1",
    run=toggle)  # -> report, points, results, mesh, legend, title, int_mtx; plug-in component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
constrheader = LBConstructHeader()  # -> header; plug-in component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
incidentradiation = LBIncidentRadiation(
    sky_mtx=skymatrix.sky_mtx,
    geometry=flatten([panel_4, geo]),
    context=flatten(geo),
    grid_size=Slider(1, range=0..10),
    irradiance=Toggle(True),
    legend_par=legendpar,
    run=Toggle(True))  # -> out, points, results, total, mesh, legend, title, int_mtx; plug-in component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
data = LBConstructData()  # -> data; plug-in component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
mesh = Mesh(incidentradiation.mesh)
sunpath_2 = LBSunPath(location=importepw.location, hoys=analysisperiod.hoys, scale=1)  # -> out, vectors, altitudes, azimuths, hoys, sun_pts, analemma, daily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; plug-in component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
directsunhours_2 = LBDirectSunHours(
    vectors=flatten(sunpath_2.vectors),
    timestep="1",
    geometry=flatten(panel_4),
    context=flatten(geo),
    grid_size=Slider(1, range=0..10),
    run=Toggle(False))  # -> out, points, results, mesh, legend, title, int_mtx; plug-in component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
boolean_toggle = BooleanToggle(True)
monthlychart = LBMonthlyChart(data=file_path, stack=boolean_toggle, time_marks=boolean_toggle, global_title="Monthly", y_axis_title="Monthly")  # -> out, data_mesh, data_lines, col_lines, legend, borders, labels, y_title, title, vis_set; plug-in component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
mesh_2 = Mesh(directsunhours_2.mesh)
